# Grasshopper definition christmas tree.gh (Grasshopper 1.0.7)
# plug-ins: treesloth01

# ---- group: Leaf
# Christmas Tree Definition
panel = Panel("1")
pt = ConstructPoint(XCoordinate=0, YCoordinate=0, ZCoordinate=0)
pt_2 = ConstructPoint(XCoordinate=0, YCoordinate=0, ZCoordinate=panel)
Z = UnitZ(Factor=1)
line = LineSDL(Start=pt, Direction=Z, Length=Slider(30, range=5..30))
number_slider = Slider(13, range=2..20)
num = Number(line)
subtraction = Subtraction(A=num, B="2")
cone = Cone(Base=pt_2, Radius=number_slider, Length=subtraction)  # -> Cone, Tip
popgeo = PopulateGeometry(Geometry=cone.Cone, Count=Slider(663, range=1..1000), Seed=1)
crv_cp = CurveClosestPoint(Point=popgeo, Curve=line)  # -> Point, Parameter, Distance
Z_2 = UnitZ(Factor="2")
move = Move(Geometry=crv_cp.Point, Motion=Z_2)  # -> Geometry, Transform
ln = Line(StartPoint=popgeo, EndPoint=crv_cp.Point)
ln_2 = Line(StartPoint=crv_cp.Point, EndPoint=move.Geometry)
ln_3 = Line(StartPoint=move.Geometry, EndPoint=popgeo)
edgesrf = EdgeSurface(CurveA=ln, CurveB=ln_2, CurveC=ln_3)
preview = CustomPreview(Geometry=edgesrf, Material=ColourSwatch(SwatchColor=RGB(94, 204, 121)))

# ----
sdivide = DivideSurface(Surface=cone.Cone, UCount=10, VCount=10)  # -> Points, Normals, Parameters
pt_3 = Point(sdivide.Points)

# ---- group: spiral pipe
pdecon = Deconstruct(Point=pt_3)  # -> XComponent, YComponent, ZComponent
sort = SortList(Keys=pdecon.ZComponent)  # -> Keys, ValuesA
rev = ReverseList(List=sort.Keys)
item = ListItem(List=sort.Keys, Index=Slider(0, range=0..100), Wrap=True)
smaller = SmallerThan(FirstNumber=pdecon.ZComponent, SecondNumber=item)  # -> SmallerThan, OrEqualTo
cull = CullPattern(List=pt_3, CullPattern=smaller.OrEqualTo)
pt_4 = Point(flatten(cull))
fcircle = CircleFit(Points=pt_4)  # -> Circle, Radius, Deviation
number_slider_2 = Slider(27, range=0..100)
area = Area(Geometry=fcircle.Circle)  # -> Area, Centroid
point = Point(area.Centroid)
number_slider_3 = Slider(525, range=0..1000)
construct_domain = ConstructDomain(DomainStart=0, DomainEnd=number_slider_2)
circle = Circle(Plane=point, Radius=number_slider)
plane_offset = PlaneOffset(BasePlane=point, Offset=number_slider_2)
range = Range(Domain=construct_domain, Steps=number_slider_3)
circle_2 = Circle(Plane=plane_offset, Radius=Slider(1, range=0..10))
merge = Merge(Data1=fcircle.Circle, Data2=circle_2)
loft = Loft(Curves=merge, Options={Adjust=False, Closed=False, LoftEnds=0, LoftSimp=0, LoftType=0, Rebuild=10, Refit=0.01})
deconstruct_brep = DeconstructBrep(Brep=loft)  # -> Faces, Edges, Vertices
list_item = ListItem(List=deconstruct_brep.Edges, Index=0, Wrap=True)
angle = Angle(VectorA=plane_offset, VectorB=list_item)  # -> Angle, Reflex
degrees = Degrees(Radians=angle.Angle)
cull_index = CullIndex(List=range, Indices=0, Wrap=True)
right_trigonometry = RightTrigonometry(Alpha=angle.Angle, PLength=cull_index)  # -> Alpha, Beta, PLength, QLength, RLength
subtraction_2 = Subtraction(A=number_slider, B=right_trigonometry.QLength)
pi = Pi(Factor=Slider(27, range=0..50, expression="x/2"))
range_2 = Range(Domain=pi, Steps=number_slider_3)
insert_items = InsertItems(List=subtraction_2, Item=number_slider, Indices="0", Wrap=True)
insert_items_2 = InsertItems(List=range, Item="0", Indices="0", Wrap=True)
expression = Expression(r=insert_items, a=range_2, Expression="r*sin(a)")
expression_2 = Expression(r=insert_items, a=range_2, Expression="r*cos(a)")
construct_point = ConstructPoint(XCoordinate=expression_2, YCoordinate=expression, ZCoordinate=insert_items_2)
deconstruct = Deconstruct(Point=construct_point)  # -> XComponent, YComponent, ZComponent
interpolate = Interpolate(Vertices=construct_point, Degree=3, Periodic=False, KnotStyle=1)  # -> Curve, Length, Domain
relative_differences = RelativeDifferences(Values=deconstruct.ZComponent)
pipe = Pipe(Curve=interpolate.Curve, Radius=Slider(0.161, range=0.005..10), Caps=0)
curve_closest_point = CurveClosestPoint(Point=construct_point, Curve=interpolate.Curve)  # -> Point, Parameter, Distance
area_2 = Area(Geometry=pipe)  # -> Area, Centroid
relative_differences_2 = RelativeDifferences(Values=curve_closest_point.Parameter)
pt_5 = Point(construct_point)
sph = Sphere(Base=pt_5, Radius=Slider(0.25, range=0..1))
preview_2 = CustomPreview(Geometry=sph, Material=ColourSwatch(SwatchColor=RGB(251, 255, 0)))
preview_3 = CustomPreview(Geometry=pipe, Material=ColourSwatch(SwatchColor=RGBA(255, 87, 87, 137)))

# ---- group: Star Construction
pt_6 = Point(crv_cp.Point)
pdecon_2 = Deconstruct(Point=pt_6)  # -> XComponent, YComponent, ZComponent
sort_2 = SortList(Keys=pdecon_2.ZComponent)  # -> Keys, ValuesA
rev_2 = ReverseList(List=sort_2.Keys)
item_2 = ListItem(List=rev_2, Index=Slider(0, range=0..100), Wrap=True)
larger = LargerThan(FirstNumber=pdecon_2.ZComponent, SecondNumber=item_2)  # -> LargerThan, OrEqualTo
cull_2 = CullPattern(List=pt_6, CullPattern=larger.OrEqualTo)
Z_3 = UnitZ(Factor=Slider(2, range=0.05..5))
move_2 = Move(Geometry=cull_2, Motion=Z_3)  # -> Geometry, Transform
xz = XZPlane(Origin=move_2.Geometry)
polygon = Polygon(Plane=xz, Radius=Slider(3.9, range=0..10), Segments=Slider(11, range=0..20), FilletRadius=0)  # -> Polygon, Length
explode = Explode(Curve=polygon.Polygon, Recursive=True)  # -> Segments, Vertices
explode_2 = Explode(Curve=explode.Segments, Recursive=True)  # -> Segments, Vertices
avr = Average(Input=explode_2.Vertices)
avr_2 = Average(Input=explode.Vertices)
ln_4 = Line(StartPoint=avr_2, EndPoint=avr)
eval = EvaluateCurve(Curve=reparameterize(ln_4), Parameter=Slider(0.511, range=0.001..10))  # -> Point, Tangent, Angle
pdecon_3 = Deconstruct(Point=avr_2)  # -> XComponent, YComponent, ZComponent
ln_5 = Line(StartPoint=eval.Point, EndPoint=explode_2.Vertices)
pt_7 = ConstructPoint(
    XCoordinate=pdecon_3.XComponent,
    YCoordinate=[pdecon_3.YComponent, Slider(1, range=0..1)],
    ZCoordinate=pdecon_3.ZComponent)
shift = ShiftPaths(Data=ln_5, Offset=-1)
join = JoinCurves(Curves=shift, Preserve=False)
extr = ExtrudePoint(Base=join, Point=pt_7)
xy = XYPlane(Origin=Point(0, 0, 0))
rotate = Rotate(Geometry=extr, Angle=degrees("180"), Plane=xy)  # -> Geometry, Transform
xz_2 = XZPlane(Origin=Point(0, 0, 0))
mirror = Mirror(Geometry=rotate.Geometry, Plane=xz_2)  # -> Geometry, Transform
brep = Brep([rotate.Geometry, mirror.Geometry])

# ---- group: tree trunk
ln_6 = Line(StartPoint=cull_2, EndPoint=pt)
pipe_2 = Pipe(Curve=ln_6, Radius=Slider(0.228, range=0..1), Caps=0)
preview_4 = CustomPreview(Geometry=pipe_2, Material=ColourSwatch(SwatchColor=RGB(128, 87, 23)))

# ---- group: christmas balls
number_slider_4 = Slider(1, range=0.1..10)
Z_4 = UnitZ(Factor=expr("-x", number_slider_4))
line_2 = LineSDL(Start=popgeo, Direction=Z_4, Length=1)
expression_3 = Expression(x=number_slider_4, Expression="(x/2)+0.2")
Z_5 = UnitZ(Factor=expr("-x", expression_3))
sph_2 = Sphere(Base=line_2, Radius=Slider(0.3, range=0.01..10))
preview_5 = CustomPreview(Geometry=line_2, Material=ColourSwatch(SwatchColor=RGB(228, 255, 94)))
move_3 = Move(Geometry=sph_2, Motion=Z_5)  # -> Geometry, Transform
preview_6 = CustomPreview(Geometry=move_3.Geometry, Material=ColourSwatch(SwatchColor=RGB(217, 113, 113)))

# ---- group: spiral pipe
plane_offset_2 = PlaneOffset(BasePlane=point, Offset=range)
circle_3 = Circle(Plane=plane_offset_2, Radius=subtraction_2)

# ----
preview_7 = CustomPreview(Geometry=brep, Material=ColourSwatch(SwatchColor=RGBA(171, 151, 0, 78)))
